# Grasshopper definition gh-ground-truth.ghx (Grasshopper 1.0.7)

python = GhPythonScript(activate=Toggle(False), start_proxy=Toggle(False))  # -> out, a; inputs activate: Boolean, start_proxy: Boolean
# ---------- python: Python ----------
from compas_ghpython import unload_modules
unload_modules('groundtruth')
from compas.rpc import Proxy

gt = None

if activate:
    if start_proxy:
        gt = Proxy('groundtruth.interactive')
    else:
        Proxy.stop_server(gt)
        
        
if gt:
    gt.ur_scan_pose()
# ---------- end python ----------
